% Simulink data dictionary bus_definition.sldd

simulation = struct(
  CoM_alingment=[0 0 0],
  Larm=0.065,
  geometry="skew-redundant",
  imu1_alignment=[0 0 0],
  imu2_alignment=[0 0 0],
  imu3_alignment=[0 0 0],
  imu1_eulerangles=[0 0 0],
  imu2_eulerangles=[0 120 45],
  imu3_eulerangles=[0 120 180],
  imu4_eulerangles=[0 120 -45],
  motion="constantZ",
  omega_V=[0 0 1.256637
   0 0 1.256637
   0 0 1.256637
   0 0 1.256637
   0 0 1.256637
   0 0 1.256637
   0 0 1.256637
   0 0 1.256637
   0 0 1.256637
   0 0 1.256637
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   ])

SIMkinematics = Simulink.Bus()
  omega_V: double[3 1]
  acc_V: double[3 1]
  mag_V: double[3 1]
  quat_NV: double[4 1]
  DCM_NV: double[3 3]
  euler_NV: double[3 1]

CONFIG = Simulink.Bus()
  omega_V: double[3 1], Unit="deg/s"  % Angular rates of the CoM in CoM body coordinates [deg/s]
  CoM_alignment: double[3 1], Unit="deg"  % Initial attitude of the body wrt the inertial reference frame [deg]
  Larm: double, Unit="m"  % Lever arm from the sensors to the CoM [m]
  geometry: string  % It can be either in-plane or skew-redundant
  imu1_alignment: double[3 1], Unit="deg"  % Alignment of the IMU 1 [deg]
  imu2_alignment: double[3 1], Unit="deg"  % Alignment of the IMU 2 [deg]
  imu3_alignment: double[3 1], Unit="deg"  % Alignment of the IMU 3 [deg]
  imu4_alignment: double[3 1], Unit="deg"  % Alignment of the IMU 4 [deg]

SIMin = Simulink.Bus()
  omega_V: double[3 1]

SensorDynamics = Simulink.Bus()
  omega_B1: double[3 1]
  omega_B2: double[3 1]
  omega_B3: double[3 1]
  omega_B4: double[3 1]
  acc_B1: double[3 1]
  acc_B2: double[3 1]
  acc_B3: double[3 1]
  acc_B4: double[3 1]
  mag_B1: double[3 1]
  mag_B2: double[3 1]
  mag_B3: double[3 1]
  mag_B4: double[3 1]

SensorData = Simulink.Bus()
  omega_B1_meas: double[3 1], Unit="deg/s"  % Angular rates of the IMU 1 in sensor body coordinates [deg/s]
  omega_B2_meas: double[3 1], Unit="deg/s"  % Angular rates of the IMU 2 in sensor body coordinates [deg/s]
  omega_B3_meas: double[3 1], Unit="deg/s"  % Angular rates of the IMU 3 in sensor body coordinates [deg/s]
  omega_B4_meas: double[3 1], Unit="deg/s"  % Angular rates of the IMU 3 in sensor body coordinates [deg/s]
  acc_B1_meas: double[3 1], Unit="m/s2"  % Acceleration of the IMU 1 in sensor body coordinates [m/s2]
  acc_B2_meas: double[3 1], Unit="m/s2"  % Acceleration of the IMU 2 in sensor body coordinates [m/s2]
  acc_B3_meas: double[3 1], Unit="m/s2"  % Acceleration of the IMU 3 in sensor body coordinates [m/s2]
  acc_B4_meas: double[3 1], Unit="m/s2"  % Acceleration of the IMU 4 in sensor body coordinates [m/s2]
  mag_B1_meas: double[3 1]
  mag_B2_meas: double[3 1]
  mag_B3_meas: double[3 1]
  mag_B4_meas: double[3 1]